# Grasshopper definition cap_2.1_volume_superfície.gh (Grasshopper 0.9.76)
# plug-ins: Python Interpreter

xy = XYPlane(Origin=Point(0, 0, 0))
python = PythonScript(x=xy)  # -> out, cyl
# ---------- python: Python ----------
import rhinoscriptsyntax as rs

pt = 0,0,0
radius = 2
height = 2
width = 2
plane = x,y

sph = rs.AddSphere(pt, radius)

cyl = rs.AddCylinder(pt, height, radius, cap=True)

#cub = rs.AddRectangularLight(pt, width, height)
#AddRectangularLight(origin, width_point, height_point)
# ---------- end python ----------
